# Dynamo custom node ProjectOrigin.dyf (Dynamo 2.3.0.5885)
# category: Crumple.Revit.Coordinates
# This node will return the Revit project origin as well as the NS, EW and elevation values. The result may be returned in Metric format (mm) or Imperial (feet).

origin = Point.Origin()
Point = Output(origin)
Metric = Input(Metric: bool = true)
python_script = Python(IN[0]=Metric)
# ---------- python_script.python (38 lines) ----------
# Made by Gavin Crump
# Free for use
# BIM Guru, www.bimguru.com.au

# Boilerplate text
import clr

# Revit services and API
clr.AddReference("RevitServices")
import RevitServices
from RevitServices.Persistence import DocumentManager 

clr.AddReference("RevitAPI")
import Autodesk 
from Autodesk.Revit.DB import *

# Current doc/app/ui
doc = DocumentManager.Instance.CurrentDBDocument

# Preparing input from dynamo to revit
metric = IN[0]

# Get project position
ori = doc.ActiveProjectLocation.GetProjectPosition(XYZ(0,0,0))

# Feet or mm converter
if metric == True:
	U_mult = 304.8
else:
	U_mult = 1

# Get EW, NS, Elev
ori_ns = round(ori.NorthSouth * U_mult, 6)
ori_ew = round(ori.EastWest   * U_mult, 6)
ori_el = round(ori.Elevation  * U_mult, 6)

# Preparing output to Dynamo
OUT = [ori_ns, ori_ew, ori_el]
# ----------------------------------------
code_block = CodeBlock(x=python_script) { x[0]; x[1]; x[2]; }
NS = Output(code_block.out0)
EW = Output(code_block.out1)
Elevation = Output(code_block.out2)
